# Grasshopper definition Tomaso gh template.gh (Grasshopper 0.9.76)
# plug-ins: Tomaso

# ----
# 01_File
nwmdl = NewModel(Run=Button())

# ----
# Run
# S-GRID
button = Button()
# S-BEAM
button_2 = Button()

# ----
# S-JOIN
button_3 = Button()
pipeline = GeometryPipeline(
    GroupByLayer=False,
    GroupByType=False,
    IncludeHidden=True,
    IncludeLocked=True,
    LayerFilter="R1",
    NameFilter="*",
    TypeFilter=1)
pipeline_2 = GeometryPipeline(
    GroupByLayer=False,
    GroupByType=False,
    IncludeHidden=True,
    IncludeLocked=True,
    LayerFilter="R2",
    NameFilter="*",
    TypeFilter=1)
entwine = Entwine(Branch00=pipeline, Branch01=pipeline_2, FlattenInputs=True)
geo = Geometry(entwine)
lng = ListLength(List=geo)
series = Series(Start=1, Step=1, Count=lng)
panel = Panel("""R1-
R2-""")
int = Integer(series)
concat = Concatenate(FragmentA=panel, FragmentB=int)
drwjntobjcts = DrawJointObjects(Run=button_3, Point=geo, Name=concat, UserName=concat, CSys="Global", MergeOff=False, MergeNumber=0)
value = ValueList({"UX": 0, "UY": 1, "UZ": 2, "RX": 3, "RY": 4, "RZ": 5}, selected=["UX", "UY", "UZ", "RX", "RY", "RZ"])
replace = ReplaceItems(List=[False, False, False, False, False, False], Item=True, Indices=value, Wrap=False)
# 07_Analyze
assgnjntrstrnts = AssignJointRestraints(Run=False, Name=concat, Value=replace, ItemType=0)

rfrshvw = RefreshView(Run=Button(), Window=0, Zoom=True)

rnanlyss = RunAnalysis(Run=Button())

rnanlyss_2 = RunAnalysis(Run=Button())

# ----
# Input
pipeline_3 = GeometryPipeline(
    GroupByLayer=False,
    GroupByType=False,
    IncludeHidden=True,
    IncludeLocked=True,
    LayerFilter="GL-X",
    NameFilter="*",
    TypeFilter=1)
pipeline_4 = GeometryPipeline(
    GroupByLayer=False,
    GroupByType=False,
    IncludeHidden=True,
    IncludeLocked=True,
    LayerFilter="GL-Y",
    NameFilter="*",
    TypeFilter=1)
pipeline_5 = GeometryPipeline(
    GroupByLayer=False,
    GroupByType=False,
    IncludeHidden=True,
    IncludeLocked=True,
    LayerFilter="GL-Z",
    NameFilter="*",
    TypeFilter=1)
pipeline_6 = GeometryPipeline(
    GroupByLayer=False,
    GroupByType=False,
    IncludeHidden=True,
    IncludeLocked=True,
    LayerFilter="C1",
    NameFilter="*",
    TypeFilter=4)
pipeline_7 = GeometryPipeline(
    GroupByLayer=False,
    GroupByType=False,
    IncludeHidden=True,
    IncludeLocked=True,
    LayerFilter="C2",
    NameFilter="*",
    TypeFilter=4)
pipeline_8 = GeometryPipeline(
    GroupByLayer=False,
    GroupByType=False,
    IncludeHidden=True,
    IncludeLocked=True,
    LayerFilter="C3",
    NameFilter="*",
    TypeFilter=4)
pipeline_9 = GeometryPipeline(
    GroupByLayer=False,
    GroupByType=False,
    IncludeHidden=True,
    IncludeLocked=True,
    LayerFilter="C4",
    NameFilter="*",
    TypeFilter=4)
pipeline_10 = GeometryPipeline(
    GroupByLayer=False,
    GroupByType=False,
    IncludeHidden=True,
    IncludeLocked=True,
    LayerFilter="W1",
    NameFilter="*",
    TypeFilter=1073741848)
pipeline_11 = GeometryPipeline(
    GroupByLayer=False,
    GroupByType=False,
    IncludeHidden=True,
    IncludeLocked=True,
    LayerFilter="G1",
    NameFilter="*",
    TypeFilter=4)
pipeline_12 = GeometryPipeline(
    GroupByLayer=False,
    GroupByType=False,
    IncludeHidden=True,
    IncludeLocked=True,
    LayerFilter="G2",
    NameFilter="*",
    TypeFilter=4)
pipeline_13 = GeometryPipeline(
    GroupByLayer=False,
    GroupByType=False,
    IncludeHidden=True,
    IncludeLocked=True,
    LayerFilter="G3",
    NameFilter="*",
    TypeFilter=4)
pipeline_14 = GeometryPipeline(
    GroupByLayer=False,
    GroupByType=False,
    IncludeHidden=True,
    IncludeLocked=True,
    LayerFilter="B1",
    NameFilter="*",
    TypeFilter=4)
pipeline_15 = GeometryPipeline(
    GroupByLayer=False,
    GroupByType=False,
    IncludeHidden=True,
    IncludeLocked=True,
    LayerFilter="J1",
    NameFilter="*",
    TypeFilter=4)
pipeline_16 = GeometryPipeline(
    GroupByLayer=False,
    GroupByType=False,
    IncludeHidden=True,
    IncludeLocked=True,
    LayerFilter="S1",
    NameFilter="*",
    TypeFilter=1073741848)
entwine_2 = Entwine(Branch00=pipeline_6, Branch01=pipeline_7, Branch02=pipeline_8, Branch03=pipeline_9, FlattenInputs=True)
entwine_3 = Entwine(Branch00=pipeline_11, Branch01=pipeline_12, Branch02=pipeline_13, FlattenInputs=True)

# ----
# 02_Edit
geo_2 = Geometry(pipeline_3)
geo_3 = Geometry(pipeline_4)
geo_4 = Geometry(pipeline_5)
sort_pt = SortPoints(Points=geo_4)  # -> Points, Indices
sort_pt_2 = SortPoints(Points=geo_3)  # -> Points, Indices
sort_pt_3 = SortPoints(Points=geo_2)  # -> Points, Indices
pdecon = Deconstruct(Point=sort_pt.Points)  # -> XComponent, YComponent, ZComponent
pdecon_2 = Deconstruct(Point=sort_pt_3.Points)  # -> XComponent, YComponent, ZComponent
pdecon_3 = Deconstruct(Point=sort_pt_2.Points)  # -> XComponent, YComponent, ZComponent
split = SplitList(List=pdecon.ZComponent, Index=1)  # -> ListA, ListB
shift = ShiftList(List=pdecon.ZComponent, Shift=1, Wrap=True)
subtraction = Subtraction(A=shift, B=pdecon.ZComponent)
cull_i = CullIndex(List=subtraction, Indices=-1, Wrap=True)
lng_2 = ListLength(List=cull_i)
panel_2 = Panel("""1
2
3
4""")
panel_3 = Panel("""A
B""")
panel_4 = Panel("""L2
L3""")
# 03_View
edtgrd = EditGrid(
    Run=button,
    Name="G1",
    XValue=pdecon_2.XComponent,
    XLabel=panel_2,
    XBubbleLocation="Start",
    XBubbleVisible="Yes",
    YValue=pdecon_3.YComponent,
    YLabel=panel_3,
    YBubbleLocation="Start",
    YBubbleVisible="Yes")
editstories = EditStories(
    Run=Button(),
    BaseElevation=split.ListA,
    NumberStories=lng_2,
    StoryNames=panel_4,
    StoryHeights=cull_i,
    SimilarToStory="None",
    SpliceAbove=False,
    SpliceHeight=0,
    Color=255)

# ----
# 04_Define
panel_5 = Panel("ConcCol")
c_script = CSharpScript(
    Run=Button(),
    Name=panel_5,
    MatProp="4000Psi",
    T3="12",
    Reference="C:\Program Files\Computers and Structures\ETABS 19\ETABSv1.dll")  # -> out, Name; inputs Run: Boolean, Name: String, MatProp: String, T3: Double
# ---------- c_script: C# ----------
    if (Run)
    {
      //dimension the ETABS Object as cOAPI type
      ETABSv1.cOAPI myETABSObject = null;

      //Use ret to check if functions return successfully (ret = 0) or fail (ret = nonzero)
      int ret = 0;

      //create API helper object
      ETABSv1.cHelper myHelper;
      myHelper = new ETABSv1.Helper();

      //get the active ETABS object
      myETABSObject = myHelper.GetObject("CSI.ETABS.API.ETABSObject");

      //Get a reference to cSapModel to access all API classes and functions
      ETABSv1.cSapModel mySapModel = default(ETABSv1.cSapModel);
      mySapModel = myETABSObject.SapModel;
      //////////////////////////////////////////////////

      //set frame prop

      ret = mySapModel.PropFrame.SetCircle(Name, MatProp, T3);

      //////////////////////////////////////////////////
      //Refresh view
      //ret = mySapModel.View.RefreshView();

      //Save model
      //ret = mySapModel.File.Save(ModelPath);

      //Run analysis
      //ret = mySapModel.Analyze.RunAnalysis();

      //Close ETABS
      //myETABSObject.ApplicationExit(false);

      //Clean up variables
      mySapModel = null;
      myETABSObject = null;

      //Check ret value
      /*
      if (ret == 0)
      {
      //MessageBox.Show("API script completed successfully.");
      }
      else
      {
      MessageBox.Show("API script FAILED to complete.");
      }
      */
    }
# ---------- end c_script ----------
c_script_2 = CSharpScript(
    Run=Button(),
    Name="ConcJst",
    MatProp="4000Psi",
    T3="4",
    T2="2",
    Reference="C:\Program Files\Computers and Structures\ETABS 19\ETABSv1.dll")  # -> out, Name; inputs Run: Boolean, Name: String, MatProp: String, T3: Double, T2: Double
# ---------- c_script_2: C# ----------
    if (Run)
    {
      //dimension the ETABS Object as cOAPI type
      ETABSv1.cOAPI myETABSObject = null;

      //Use ret to check if functions return successfully (ret = 0) or fail (ret = nonzero)
      int ret = 0;

      //create API helper object
      ETABSv1.cHelper myHelper;
      myHelper = new ETABSv1.Helper();

      //get the active ETABS object
      myETABSObject = myHelper.GetObject("CSI.ETABS.API.ETABSObject");

      //Get a reference to cSapModel to access all API classes and functions
      ETABSv1.cSapModel mySapModel = default(ETABSv1.cSapModel);
      mySapModel = myETABSObject.SapModel;
      //////////////////////////////////////////////////

      //set frame prop

      ret = mySapModel.PropFrame.SetRectangle(Name, MatProp, T3, T2);


      //////////////////////////////////////////////////
      //Refresh view
      //ret = mySapModel.View.RefreshView();

      //Save model
      //ret = mySapModel.File.Save(ModelPath);

      //Run analysis
      //ret = mySapModel.Analyze.RunAnalysis();

      //Close ETABS
      //myETABSObject.ApplicationExit(false);

      //Clean up variables
      mySapModel = null;
      myETABSObject = null;

      //Check ret value
      /*
      if (ret == 0)
      {
      //MessageBox.Show("API script completed successfully.");
      }
      else
      {
      MessageBox.Show("API script FAILED to complete.");
      }
      */
    }
# ---------- end c_script_2 ----------
c_script_3 = CSharpScript(
    Run=button_2,
    Name="ConcGrdr",
    MatProp="4000Psi",
    T3="12",
    T2="6",
    Reference="C:\Program Files\Computers and Structures\ETABS 19\ETABSv1.dll")  # -> out, Name; inputs Run: Boolean, Name: String, MatProp: String, T3: Double, T2: Double; same code as c_script_2
c_script_4 = CSharpScript(
    Run=Button(),
    Name="ConcBm",
    MatProp="4000Psi",
    T3="8",
    T2="4",
    Reference="C:\Program Files\Computers and Structures\ETABS 19\ETABSv1.dll")  # -> out, Name; inputs Run: Boolean, Name: String, MatProp: String, T3: Double, T2: Double; same code as c_script_2

# ----
# S-SLAB
panel_6 = Panel("4000Psi")
dfnslbsctn = DefineSlabSlabSection(Run=Button(), Name="Slab1", SlabType=0, ShellType=1, MatProp=panel_6, Thickness="6", Color=-1)
geo_5 = Geometry(pipeline_16)
lng_3 = ListLength(List=geo_5)
series_2 = Series(Start=1, Step=1, Count=lng_3)
int_2 = Integer(series_2)
concat_2 = Concatenate(FragmentA="S1-", FragmentB=int_2)
drwflrwallobjcts = DrawFloorWallObjects(Run=False, Area=geo_5, Name=concat_2, PropName="Slab1", UserName=concat_2, CSys="Global")
dir = ValueList({"Local 1 axis": 1, "Local 2 axis": 2, "Local 3 axis": 3, "X direction": 4, "Y direction": 5, "Z direction": 6, "Projected X direction": 7, "Projected Y direction": 8, "Projected Z direction": 9, "Gravity direction": 10, "Projected Gravity direction": 11}, selected="Projected Z direction")
meshoption = ValueList({"Default", "No Mesh", "Auto Cookie Cut", "Mesh Nv x Nh"}, selected="No Mesh")
expression = Expression(x=Slider(40, range=0..100), Expression="x/1000/144")
addrestraints = ValueList({"Yes", "No"}, selected="Yes")
value_2 = ValueList({"F11": 1, "F22": 1, "F33": 1, "M11": 0.35, "M22": 0.35, "M12": 0.35, "V13": 1, "V23": 1, "Mass": 1, "Weight": 1}, selected=["F11", "F22", "F33", "M11", "M22", "M12", "V13", "V23", "Mass", "Weight"])
csys = ValueList({"Global", "Local"}, selected="Global")
assnshllatflrmshoptns = AssignShellFloorAutoMeshOptions(Run=False, Name=concat_2, MeshOption=meshoption, AddRestraints=addrestraints)
assgnshllstffnssmdfrs = AssignShellStiffnessModifiers(Run=False, Name=concat_2, Value=value_2, ItemType=0)
assgnshllldsunfrm = AssignShellLoadsUniform(Run=False, Name=concat_2, LoadPat="Live", Dir=dir, Value=expression, CSys=csys, Replace=True, ItemType=0)

# ----
# S-WALL
panel_7 = Panel("P1")
dfnprlbls = DefinePierLabels(Run=Button(), Name=panel_7)
geo_6 = Geometry(pipeline_10)
lng_4 = ListLength(List=geo_6)
series_3 = Series(Start=1, Step=1, Count=lng_4)
int_3 = Integer(series_3)
concat_3 = Concatenate(FragmentA="W1-", FragmentB=int_3)
drwflrwallobjcts_2 = DrawFloorWallObjects(Run=False, Area=geo_6, Name=concat_3, PropName="Wall1", UserName=concat_3, CSys="Global")
meshoption_2 = ValueList({"Default", "Auto Rectangular", "Mesh Nv x Nh"}, selected="Auto Rectangular")
addrestraints_2 = ValueList({"Yes", "No"}, selected="Yes")
value_3 = ValueList({"F11": 1, "F22": 1, "F33": 1, "M11": 0.35, "M22": 0.35, "M12": 0.35, "V13": 1, "V23": 1, "Mass": 1, "Weight": 1}, selected=["F11", "F22", "F33", "M11", "M22", "M12", "V13", "V23", "Mass", "Weight"])
assnshllatwllmshoptns = AssignShellWallAutoMeshOptions(Run=Button(), Name=concat_3, MeshOption=meshoption_2, AddRestraints=addrestraints_2)
assgnshllstffnssmdfrs_2 = AssignShellStiffnessModifiers(Run=False, Name=concat_3, Value=value_3, ItemType=0)
assgnshllprlbl = AssignShellPierLabel(Run=False, Name=concat_3, PierName=panel_7, ItemType=0)

# ----
# 05_Draw
geo_7 = Geometry(entwine_3)
geo_8 = Geometry(pipeline_14)
geo_9 = Geometry(pipeline_15)
lng_5 = ListLength(List=geo_7)
lng_6 = ListLength(List=geo_8)
lng_7 = ListLength(List=geo_9)
series_4 = Series(Start=1, Step=1, Count=lng_5)
series_5 = Series(Start=1, Step=1, Count=lng_6)
series_6 = Series(Start=1, Step=1, Count=lng_7)
panel_8 = Panel("""G1-
G2-
G3-""")
int_4 = Integer(series_4)
int_5 = Integer(series_5)
int_6 = Integer(series_6)
concat_4 = Concatenate(FragmentA=graft(panel_8), FragmentB=int_4)
concat_5 = Concatenate(FragmentA="B1-", FragmentB=int_5)
concat_6 = Concatenate(FragmentA="J1-", FragmentB=int_6)
drwbmclmnbrc = DrawBeamColumnBraceObject(Run=False, Line=geo_7, Name=concat_4, PropName=c_script_3.Name, UserName=concat_4, CSys="Global")
drwbmclmnbrc_2 = DrawBeamColumnBraceObject(Run=False, Line=geo_8, Name=concat_5, PropName=c_script_4.Name, UserName=concat_5, CSys="Global")
drwbmclmnbrc_3 = DrawBeamColumnBraceObject(Run=False, Line=geo_9, Name=concat_6, PropName=c_script_2.Name, UserName=concat_6, CSys="Global")

# ----
# 06_Assign
startvalue_endvalue = ValueList({"Axial": 0, "Shear 2": 1, "Shear 3": 2, "Torsion": 3, "Moment 22": 4, "Moment 33": 5}, selected=[])
startvalue_endvalue_2 = ValueList({"Axial": 0, "Shear 2": 1, "Shear 3": 2, "Torsion": 3, "Moment 22": 4, "Moment 33": 5}, selected=[])
startvalue_endvalue_3 = ValueList({"Axial": 0, "Shear 2": 1, "Shear 3": 2, "Torsion": 3, "Moment 22": 4, "Moment 33": 5}, selected=["Moment 22", "Moment 33"])
insertion_point = ValueList({"Bottom Left": 1, "Bottom Center": 2, "Bottom Right": 3, "Middle Left": 4, "Middle Center": 5, "Middle Right": 6, "Top Left": 7, "Top Center": 8, "Top Right": 9, "Centroid": 10, "Shear Center": 11}, selected="Top Center")
value_4 = ValueList({"Area": 1, "As2": 1, "As3": 1, "Torsion": 1, "I22": 0.35, "I33": 0.35, "Mass": 1, "Weight": 1}, selected=["Area", "As2", "As3", "Torsion", "I22", "I33", "Mass", "Weight"])
replace_2 = ReplaceItems(List=[False, False, False, False, False, False], Item=True, Indices=startvalue_endvalue, Wrap=False)
replace_3 = ReplaceItems(List=[False, False, False, False, False, False], Item=True, Indices=startvalue_endvalue_2, Wrap=False)
replace_4 = ReplaceItems(List=[False, False, False, False, False, False], Item=True, Indices=startvalue_endvalue_3, Wrap=False)
assgnfrminsrtnpt = AssignFrameInsertionPoint(
    Run=False,
    Name=concat_5,
    CardinalPoint=insertion_point,
    Mirror2=False,
    StiffTransform=False,
    Offset1=0,
    Offset2=0,
    CSys="Local",
    ItemType=0)
assgnfrminsrtnpt_2 = AssignFrameInsertionPoint(
    Run=False,
    Name=concat_4,
    CardinalPoint=insertion_point,
    Mirror2=False,
    StiffTransform=False,
    Offset1=0,
    Offset2=0,
    CSys="Local",
    ItemType=0)
assgnfrminsrtnpt_3 = AssignFrameInsertionPoint(
    Run=False,
    Name=concat_6,
    CardinalPoint=insertion_point,
    Mirror2=False,
    StiffTransform=False,
    Offset1=0,
    Offset2=0,
    CSys="Local",
    ItemType=0)
assgnfrmrlssprtlfxty = AssignFrameReleasesPartialFixity(
    Run=False,
    Name=concat_5,
    II=replace_2,
    JJ=replace_2,
    StartValue=[0, 0, 0, 0, 0, 0],
    EndValue=[0, 0, 0, 0, 0, 0],
    ItemType=0)
assgnfrmprprtymdfrs = AssignFramePropertyModifiers(Run=False, Name=concat_5, Value=value_4, ItemType=0)
assgnfrmrlssprtlfxty_2 = AssignFrameReleasesPartialFixity(
    Run=False,
    Name=concat_4,
    II=replace_3,
    JJ=replace_3,
    StartValue=[0, 0, 0, 0, 0, 0],
    EndValue=[0, 0, 0, 0, 0, 0],
    ItemType=0)
assgnfrmprprtymdfrs_2 = AssignFramePropertyModifiers(Run=False, Name=concat_4, Value=value_4, ItemType=0)
assgnfrmrlssprtlfxty_3 = AssignFrameReleasesPartialFixity(
    Run=False,
    Name=concat_6,
    II=replace_4,
    JJ=replace_4,
    StartValue=[0, 0, 0, 0, 0, 0],
    EndValue=[0, 0, 0, 0, 0, 0],
    ItemType=0)
assgnfrmprprtymdfrs_3 = AssignFramePropertyModifiers(Run=False, Name=concat_6, Value=value_4, ItemType=0)

# ----
# 08_Design
toggle = BooleanToggle(True)
gtfrmsctns = GetFrameSections(Run=toggle)  # -> NumberNames, MyName, PropType, T3, T2, Tf, Tw, T2b, Tfb, Area
gtfrmsctns_2 = GetFrameSections(Run=Toggle(True))  # -> NumberNames, MyName, PropType, T3, T2, Tf, Tw, T2b, Tfb, Area
gtfrmsctns_3 = GetFrameSections(Run=Toggle(True))  # -> NumberNames, MyName, PropType, T3, T2, Tf, Tw, T2b, Tfb, Area
gtfrmsctns_4 = GetFrameSections(Run=Toggle(True))  # -> NumberNames, MyName, PropType, T3, T2, Tf, Tw, T2b, Tfb, Area

# ----
# S-COLS
geo_10 = Geometry(entwine_2)
lng_8 = ListLength(List=geo_10)
series_7 = Series(Start=1, Step=1, Count=lng_8)
panel_9 = Panel("""C1-
C2-
C3-
C4-""")
int_7 = Integer(series_7)
concat_7 = Concatenate(FragmentA=panel_9, FragmentB=int_7)
drwbmclmnbrc_4 = DrawBeamColumnBraceObject(Run=False, Line=geo_10, Name=concat_7, PropName=c_script.Name, UserName=concat_7, CSys="Global")
startvalue_endvalue_4 = ValueList({"Axial": 0, "Shear 2": 1, "Shear 3": 2, "Torsion": 3, "Moment 22": 4, "Moment 33": 5}, selected=["Axial", "Shear 2", "Shear 3", "Torsion", "Moment 22", "Moment 33"])
insertion_point_2 = ValueList({"Bottom Left": 1, "Bottom Center": 2, "Bottom Right": 3, "Middle Left": 4, "Middle Center": 5, "Middle Right": 6, "Top Left": 7, "Top Center": 8, "Top Right": 9, "Centroid": 10, "Shear Center": 11}, selected="Centroid")
value_5 = ValueList({"Area": 1, "As2": 1, "As3": 1, "Torsion": 1, "I22": 0.7, "I33": 0.7, "Mass": 1, "Weight": 1}, selected=["Area", "As2", "As3", "Torsion", "I22", "I33", "Mass", "Weight"])
replace_5 = ReplaceItems(List=[False, False, False, False, False, False], Item=True, Indices=startvalue_endvalue_4, Wrap=False)
assgnfrminsrtnpt_4 = AssignFrameInsertionPoint(
    Run=False,
    Name=concat_7,
    CardinalPoint=insertion_point_2,
    Mirror2=False,
    StiffTransform=False,
    Offset1=0,
    Offset2=0,
    CSys="Local",
    ItemType=0)
assgnfrmrlssprtlfxty_4 = AssignFrameReleasesPartialFixity(
    Run=False,
    Name=concat_7,
    II=replace_5,
    JJ=replace_5,
    StartValue=[0, 0, 0, 0, 0, 0],
    EndValue=[0, 0, 0, 0, 0, 0],
    ItemType=0)
assgnfrmprprtymdfrs_4 = AssignFramePropertyModifiers(Run=False, Name=concat_7, Value=value_5, ItemType=0)
entwine_4 = Entwine(
    Branch00=gtfrmsctns_4.MyName,
    Branch01=gtfrmsctns_4.PropType,
    Branch02=gtfrmsctns_4.T3,
    Branch03=gtfrmsctns_4.T2,
    Branch04=gtfrmsctns_4.Tf,
    Branch05=gtfrmsctns_4.Tw,
    Branch06=gtfrmsctns_4.T2b,
    Branch07=gtfrmsctns_4.Tfb,
    Branch08=gtfrmsctns_4.Area,
    FlattenInputs=True)
keysearch = KeyValueSearch(Keys=gtfrmsctns_4.MyName, Values=entwine_4, Search=panel_5)
flip = FlipMatrix(Data=keysearch)
item = ListItem(List=flip, Index=0, Wrap=True)  # -> flatten(Item), flatten(Item1), flatten(Item2), flatten(Item3), flatten(Item4), flatten(Item5), flatten(Item6), flatten(Item7)
rectangle = Rectangle(Plane=PlaneXY(0, 0, 0), XSize=item.Item2, YSize=item.Item1, Radius=0)  # -> Rectangle, Length
X = UnitX(Factor=expr("-x/2", item.Item2))
move = Move(Geometry=rectangle.Rectangle, Motion=X)  # -> Geometry, Transform
Y = UnitY(Factor=expr("-x/2", item.Item1))
move_2 = Move(Geometry=move.Geometry, Motion=Y)  # -> Geometry, Transform
boundary = BoundarySurfaces(Edges=move_2.Geometry)
extrude = ExtrudeLinear(Profile=boundary, OrientationP=PlaneXY(0, 0, 0), Axis=geo_10)
brep = Brep(extrude)

# ----
# Output
entwine_5 = Entwine(
    Branch00=gtfrmsctns.MyName,
    Branch01=gtfrmsctns.PropType,
    Branch02=gtfrmsctns.T3,
    Branch03=gtfrmsctns.T2,
    Branch04=gtfrmsctns.Tf,
    Branch05=gtfrmsctns.Tw,
    Branch06=gtfrmsctns.T2b,
    Branch07=gtfrmsctns.Tfb,
    Branch08=gtfrmsctns.Area,
    FlattenInputs=True)
entwine_6 = Entwine(
    Branch00=gtfrmsctns_2.MyName,
    Branch01=gtfrmsctns_2.PropType,
    Branch02=gtfrmsctns_2.T3,
    Branch03=gtfrmsctns_2.T2,
    Branch04=gtfrmsctns_2.Tf,
    Branch05=gtfrmsctns_2.Tw,
    Branch06=gtfrmsctns_2.T2b,
    Branch07=gtfrmsctns_2.Tfb,
    Branch08=gtfrmsctns_2.Area,
    FlattenInputs=True)
entwine_7 = Entwine(
    Branch00=gtfrmsctns_3.MyName,
    Branch01=gtfrmsctns_3.PropType,
    Branch02=gtfrmsctns_3.T3,
    Branch03=gtfrmsctns_3.T2,
    Branch04=gtfrmsctns_3.Tf,
    Branch05=gtfrmsctns_3.Tw,
    Branch06=gtfrmsctns_3.T2b,
    Branch07=gtfrmsctns_3.Tfb,
    Branch08=gtfrmsctns_3.Area,
    FlattenInputs=True)
keysearch_2 = KeyValueSearch(Keys=gtfrmsctns.MyName, Values=entwine_5, Search="ConcGrdr")
keysearch_3 = KeyValueSearch(Keys=gtfrmsctns_2.MyName, Values=entwine_6, Search="ConcBm")
keysearch_4 = KeyValueSearch(Keys=gtfrmsctns_3.MyName, Values=entwine_7, Search="ConcJst")
flip_2 = FlipMatrix(Data=keysearch_2)
flip_3 = FlipMatrix(Data=keysearch_3)
flip_4 = FlipMatrix(Data=keysearch_4)
item_2 = ListItem(List=flip_2, Index=0, Wrap=True)  # -> flatten(Item), flatten(Item1), flatten(Item2), flatten(Item3), flatten(Item4), flatten(Item5), flatten(Item6), flatten(Item7)
item_3 = ListItem(List=flip_3, Index=0, Wrap=True)  # -> flatten(Item), flatten(Item1), flatten(Item2), flatten(Item3), flatten(Item4), flatten(Item5), flatten(Item6), flatten(Item7)
item_4 = ListItem(List=flip_4, Index=0, Wrap=True)  # -> flatten(Item), flatten(Item1), flatten(Item2), flatten(Item3), flatten(Item4), flatten(Item5), flatten(Item6), flatten(Item7)
rectangle_2 = Rectangle(Plane=PlaneXY(0, 0, 0), XSize=item_2.Item2, YSize=item_2.Item1, Radius=0)  # -> Rectangle, Length
rectangle_3 = Rectangle(Plane=PlaneXY(0, 0, 0), XSize=item_3.Item2, YSize=item_3.Item1, Radius=0)  # -> Rectangle, Length
rectangle_4 = Rectangle(Plane=PlaneXY(0, 0, 0), XSize=item_4.Item2, YSize=item_4.Item1, Radius=0)  # -> Rectangle, Length
X_2 = UnitX(Factor=expr("-x/2", item_2.Item2))
X_3 = UnitX(Factor=expr("-x/2", item_3.Item2))
X_4 = UnitX(Factor=expr("-x/2", item_4.Item2))
move_3 = Move(Geometry=rectangle_2.Rectangle, Motion=X_2)  # -> Geometry, Transform
move_4 = Move(Geometry=rectangle_3.Rectangle, Motion=X_3)  # -> Geometry, Transform
move_5 = Move(Geometry=rectangle_4.Rectangle, Motion=X_4)  # -> Geometry, Transform
Y_2 = UnitY(Factor=expr("-x/2", item_2.Item1))
Y_3 = UnitY(Factor=expr("-x/2", item_3.Item1))
Y_4 = UnitY(Factor=expr("-x/2", item_4.Item1))
move_6 = Move(Geometry=move_3.Geometry, Motion=Y_2)  # -> Geometry, Transform
move_7 = Move(Geometry=move_4.Geometry, Motion=Y_3)  # -> Geometry, Transform
move_8 = Move(Geometry=move_5.Geometry, Motion=Y_4)  # -> Geometry, Transform
boundary_2 = BoundarySurfaces(Edges=move_6.Geometry)
boundary_3 = BoundarySurfaces(Edges=move_7.Geometry)
boundary_4 = BoundarySurfaces(Edges=move_8.Geometry)
extrude_2 = ExtrudeLinear(Profile=boundary_2, OrientationP=PlaneXY(0, 0, 0), Axis=geo_7)
extrude_3 = ExtrudeLinear(Profile=boundary_3, OrientationP=PlaneXY(0, 0, 0), Axis=geo_8)
extrude_4 = ExtrudeLinear(Profile=boundary_4, OrientationP=PlaneXY(0, 0, 0), Axis=geo_9)
brep_2 = Brep(extrude_3)
brep_3 = Brep(extrude_4)
brep_4 = Brep(extrude_2)
